# Grasshopper definition data-driven-modules.ghx (Grasshopper 1.0.8)
# plug-ins: Bifocals

curve = Curve(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)
curve_2 = Curve(<curve referenced from the Rhino model>)

# ----
# 08. Mapping Table
# output : thickness, foot length
# import CVS / config
select_the_runner = Slider(140, range=0..400)
path = FilePath("E:\09  GITHUB\konstantina_personal\runner-stiffness-analysis\runner-stiffness-analysis\config.json")
path_2 = FilePath("E:\09  GITHUB\konstantina_personal\runner-stiffness-analysis\runner-stiffness-analysis\data\clustered\runners_clustered.csv")

number_slider = Slider(40, range=0..100)  # disabled
number_slider_2 = Slider(150, range=0..1000)  # disabled
number_slider_3 = Slider(300, range=0..1000)  # disabled
# PART 2  - 2.1 Data Interpretation
number_slider_4 = Slider(4000, range=0..10000)  # disabled
number_slider_5 = Slider(12, range=0..14)
number_slider_6 = Slider(40, range=0..100)  # disabled
number_slider_7 = Slider(150, range=0..1000)  # disabled
number_slider_8 = Slider(300, range=0..1000)  # disabled
# 05. Mapping Table
# output : thickness, foot length
point = Point(<point referenced from the Rhino model>)  # disabled
number_slider_9 = Slider(4000, range=0..10000)  # disabled

impact_force = Slider(1754, range=200..2000)  # disabled
shoe_size = Slider(42, range=36..46)  # disabled
# 03. Mapping Table
# output : thickness
runner_weight = Slider(150, range=50..150)  # disabled
python_3_script = Python3Script(
    runner_weight=runner_weight,
    impact_force=impact_force,
    shoe_size=shoe_size,
    weight_min=number_slider_6,
    weight_max=number_slider_7,
    force_min=number_slider_8,
    force_max=number_slider_9)  # -> out, thickness; inputs runner_weight: Double, impact_force: Double, shoe_size: Double, weight_min: Double, weight_max: Double; disabled
# ---------- python_3_script: Python ----------
# ----------------------
# Fabrication Constraints (editable config)
# ----------------------
MIN_THICKNESS = 2.0    # foam injection limit, Vietnam supplier
MAX_THICKNESS = 4.5    # maximum wall thickness

# ----------------------
# Functions
# ----------------------
def remap(value, from_min, from_max, to_min, to_max):
    normalized = (value - from_min) / (from_max - from_min)
    return to_min + normalized * (to_max - to_min)


# ----------------------
# Score
# ----------------------
norm_weight = remap(runner_weight, weight_min, weight_max, 0.0, 1.0)
norm_force  = remap(impact_force, force_min, force_max, 0.0, 1.0)

score = 0.5 * norm_weight + 0.5 * norm_force

# ----------------------
# Profile Label & Thickness
# ----------------------
if score < 0.33:
    profile = "Soft"
    thickness = MIN_THICKNESS
elif score < 0.66:
    profile = "Medium"
    thickness = remap(0.5, 0.0, 1.0, MIN_THICKNESS, MAX_THICKNESS)
else:
    profile = "Firm"
    thickness = MAX_THICKNESS


print(f"Profile    : {profile}")
print(f"Load score : {round(score, 3)}")
print(f"Thickness  : {round(thickness, 2)} mm")
# ---------- end python_3_script ----------
cloud_pod_inputs = Panel(python_3_script.out)  # disabled

number_slider_10 = Slider(150, range=0..1000)  # disabled
number_slider_11 = Slider(300, range=0..1000)  # disabled
number_slider_12 = Slider(4000, range=0..10000)  # disabled
number_slider_13 = Slider(40, range=0..100)  # disabled

impact_force_2 = Slider(1852, range=200..2000)  # disabled
# 05. Mapping Table
# output : thickness, foot length
runner_weight_2 = Slider(146, range=50..150)  # disabled
shoe_size_2 = Slider(44, range=36..46)  # disabled
python_3_script_2 = Python3Script(
    runner_weight=runner_weight_2,
    impact_force=impact_force_2,
    shoe_size=shoe_size_2,
    weight_min=number_slider_13,
    weight_max=number_slider_10,
    force_min=number_slider_11,
    force_max=number_slider_12)  # -> out, thickness, foot_length; inputs runner_weight: Double, impact_force: Double, shoe_size: Double, weight_min: Double, weight_max: Double; disabled
# ---------- python_3_script_2: Python ----------
import Rhino.Geometry as rg

# ----------------------
# Fabrication Constraints (editable config)
# ----------------------
MIN_THICKNESS = 2.0    # foam injection limit, Vietnam supplier
MAX_THICKNESS = 4.5    # maximum wall thickness

# ----------------------
# Functions
# ----------------------
def remap(value, from_min, from_max, to_min, to_max):
    normalized = (value - from_min) / (from_max - from_min)
    return to_min + normalized * (to_max - to_min)

# EU shoe size to foot length in mm > curve length
def shoe_size_to_length(eu_size):
    return eu_size * 6.67 + 10  # rough formula


# ----------------------
# Score
# ----------------------
norm_weight = remap(runner_weight, weight_min, weight_max, 0.0, 1.0)
norm_force  = remap(impact_force, force_min, force_max, 0.0, 1.0)

score = 0.5 * norm_weight + 0.5 * norm_force

# ----------------------
# Profile Label & Thickness
# ----------------------
if score < 0.33:
    profile = "Soft"
    thickness = MIN_THICKNESS
elif score < 0.66:
    profile = "Medium"
    thickness = remap(0.5, 0.0, 1.0, MIN_THICKNESS, MAX_THICKNESS)
else:
    profile = "Firm"
    thickness = MAX_THICKNESS

# Scale diameter range by shoe size
foot_length = shoe_size_to_length(shoe_size)


print(f"runner weight      : {runner_weight} kg")
print(f"impact_force      : {impact_force} N")
print(f"EU size      : {shoe_size} mm")
print(f"------")
print(f"Profile      : {profile}")
print(f"Load score   : {round(score, 3)}")
print(f"------")
print(f"Thickness    : {round(thickness, 2)} mm")
print(f"Foot length  : {round(foot_length, 2)} mm")
# ---------- end python_3_script_2 ----------
cloud_pod_inputs_2 = Panel(python_3_script_2.out)  # disabled

outline = Curve(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)

origin = Point(Point(17.98900124, 0.9464379616, 0))
python_3_script_3 = Python3Script(cvs_path=path_2, config_path=path, index=140, pod_density=number_slider_5, in_point=origin, outline_curve=outline)  # -> out, thickness, foot_length, foot_width, radius_out_min, radius_out_max, min_hole_diameter, rectangle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; inputs cvs_path: String, config_path: String, index: Int32, pod_density: Int32, in_point: Point3d, outline_curve: Curve
# ---------- python_3_script_3: Python ----------
import Rhino.Geometry as rg
import csv
import json

# ----------------------
# Load files
# ----------------------

# config_path: GH string input (Panel with the path, or File Path component)
with open(config_path, "r") as f:
    config = json.load(f)


# csv_path: string input (GH Panel or File Path component)
# i: number slider input (integer, range 0 to len(rows)-1)

with open(cvs_path, newline='') as f:
    reader = csv.DictReader(f)
    rows = list(reader)


# select the runner at index 
runner = rows[index]

# fetch data per runner
runner_weight = float(runner["runner_weight_kg"])
impact_force = float(runner["impact_force_newtons"])
shoe_size = float(runner["preferred_shoe_size"])
load_score = float(runner["load_score"])
profile = runner["stiffness_profile"]

# fetch config values
weight_min = config["data_processing"]["weight_min"]
weight_max = config["data_processing"]["weight_max"]

min_thickness = config["fabrication_constraints"]["min_thickness"]
max_thickness = config["fabrication_constraints"]["max_thickness"]
min_hole_diameter = config["fabrication_constraints"]["min_hole_diameter"]

# ----------------------
# Functions
# ----------------------
def remap(value, from_min, from_max, to_min, to_max):
    normalized = (value - from_min) / (from_max - from_min)
    return to_min + normalized * (to_max - to_min)

# ----------------------
# Thickness
# ----------------------
if profile == "Soft":
    thickness = min_thickness
elif profile == "Medium":
    thickness = remap(0.5, 0.0, 1.0, min_thickness, max_thickness)
else:
    thickness = max_thickness

# ----------------------
# Radius Outter Range 
# ----------------------

# anatomical shape stays constant: parabola peak at heel, minimum at toe
# but the actual min/max radius values come from the runner's weight

radius_out_min = remap(runner_weight, weight_min, weight_max, 8.0, 11.0)   # toe area
radius_out_max = remap(runner_weight, weight_min, weight_max, 13.0, 18.0)  # heel area


# ----------------------
# Shoe Size to Foot Dimensions
# ----------------------
foot_length = remap(shoe_size, 36, 48, 225.0, 305.0)  # mm
foot_width  = remap(shoe_size, 36, 48, 85.0, 180.0)   # mm

corner_a = in_point
corner_b = in_point + (rg.Vector3d.XAxis * foot_length)
corner_c = in_point + (rg.Vector3d.XAxis * foot_length) + (rg.Vector3d.YAxis * foot_width)
corner_d = in_point + (rg.Vector3d.YAxis * foot_width)

rectangle = rg.Polyline([corner_a, corner_b, corner_c, corner_d, corner_a]).ToNurbsCurve()

pt_1 = corner_a + (rg.Vector3d.YAxis * foot_width / 2)
pt_2 = corner_b + (rg.Vector3d.YAxis * foot_width / 2)
middle_line = rg.Polyline([pt_1,pt_2]).ToNurbsCurve()

# divide curve - divide by length so pod spacing stays proportional
# similar to curve from foot length
pod_spacing = foot_length / (pod_density + 1) # spaced proportionally
t_params = middle_line.DivideByLength(pod_spacing, True)
map_pts = [middle_line.PointAt(t) for t in t_params]
#print(f"curve points are in total: {len(map_pts)}")

# -------------------------------------------------
# Scale Shoe Outline Curve to Foot Dimensions
# -------------------------------------------------

# outline_curve: GH input - the small reference shoe outline curve 

bbox = outline_curve.GetBoundingBox(True)
current_length = bbox.Max.X - bbox.Min.X
current_width  = bbox.Max.Y - bbox.Min.Y

scale_x = foot_length / current_length
scale_y = foot_width / current_width

# anchor scaling at the curve's own origin corner 
anchor = bbox.Min

scale_transform = rg.Transform.Scale(
    rg.Plane(anchor, rg.Vector3d.XAxis, rg.Vector3d.YAxis),
    scale_x, scale_y, 1.0
)

scaled_outline = outline_curve.Duplicate()
scaled_outline.Transform(scale_transform)

# move scaled outline to match in_point 
move_vec = in_point - anchor
move_transform = rg.Transform.Translation(move_vec)
scaled_outline.Transform(move_transform)

# ----------------------
# Build Grid of Points
# ----------------------
grid_x = 10
grid_y = 10

bbox = rectangle.GetBoundingBox(True)

origin = bbox.Min
length = bbox.Max.X - bbox.Min.X
width  = bbox.Max.Y - bbox.Min.Y

grid_points = []
for i in range(grid_x):
    for j in range(grid_y):
        u = i / (grid_x - 1)
        v = j / (grid_y - 1)
        pt = rg.Point3d(origin.X + u * length, origin.Y + v * width, origin.Z)
        grid_points.append((pt, u, v))

print(f"Profile : {profile}")
print(f"Load score : {round(load_score, 3)} \n .")
print(f"Weight : {runner_weight} kg")
print(f"Impact_force : {impact_force} N")
print(f"EU size : {shoe_size} mm \n .")
print(f"Thickness : {round(thickness, 2)} mm \n .")
print(f"Radius range : {round(radius_out_min,2)} - {round(radius_out_max,2)} mm \n .")
print(f"Foot length : {round(foot_length,2)} mm ")
print(f"Foot width : {round(foot_width,2)} mm \n .")
# ---------- end python_3_script_3 ----------
geometry_inputs = Panel(python_3_script_3.out)

number_slider_14 = Slider(100, range=0..100)
data = Data(python_3_script_3.map_pts)

data_2 = Data(python_3_script_3.rectangle)
bbox = BoundingBox(Content=data_2, Plane=PlaneXY(0, 0, 0))  # -> Box, Box_2
debox = DeconstructBox(Box=bbox.Box)  # -> Plane, X, Y, Z
dedomain = DeconstructDomain(Domain=debox.X)  # -> Start, End
dedomain_2 = DeconstructDomain(Domain=debox.Y)  # -> Start, End
geo = Geometry(data)
image = ImageSampler(
    geo,
    FilePath="E:\01  WORK\05 Post Grad\Αιτήσεις 2025\Preparation\ON\zone-example-medium_.jpg",
    Filter="Value",
    Interpolate=True,
    Umax=92,
    Umin=1,
    Vmax=269,
    Vmin=17,
    Wrap=2)
data_3 = Data(image)

panel = Panel(dedomain.Start)
panel_2 = Panel(dedomain.End)
panel_3 = Panel(dedomain_2.Start)
panel_4 = Panel(dedomain_2.End)

python_3_script_4 = Python3Script(rectangle=data_2, grid_x=number_slider_14, grid_y=number_slider_14)  # -> out, a; inputs rectangle: Curve, grid_x: Int32, grid_y: Int32
# ---------- python_3_script_4: Python ----------
import Rhino.Geometry as rg
import System.Drawing as sd

# ----------------------
# Inputs
# ----------------------
# rectangle: the foot-sized rectangle curve (already scaled)
# image_path: string input, path to the pressure map image
# grid_x, grid_y: integers, number of points along length/width
# radius_min, radius_max: floats, circle size range

# ----------------------
# Build Grid of Points
# ----------------------
bbox = rectangle.GetBoundingBox(True)

origin = bbox.Min
length = bbox.Max.X - bbox.Min.X
width  = bbox.Max.Y - bbox.Min.Y

grid_points = []
for i in range(grid_x):
    for j in range(grid_y):
        u = i / (grid_x - 1)
        v = j / (grid_y - 1)
        pt = rg.Point3d(origin.X + u * length, origin.Y + v * width, origin.Z)
        grid_points.append((pt, u, v))


# ----------------------
# Functions
# ----------------------
def remap(value, from_min, from_max, to_min, to_max):
    normalized = (value - from_min) / (from_max - from_min)
    return to_min + normalized * (to_max - to_min)

# ----------------------
# Generate Circles
# ----------------------
circles = []
plane_world = rg.Plane.WorldXY

for pt, u, v in grid_points:
    #brightness = sample_brightness(u, v)
    radius = remap(values, 0.0, 1.0, radius_min, radius_max)
    
    circle_plane = rg.Plane(pt, plane_world.XAxis, plane_world.YAxis)
    circle = rg.Circle(circle_plane, radius)
    circles.append(circle)
# ---------- end python_3_script_4 ----------
double_array = BooleanToggle(True)

# ----
# 01. Parametric Cylinder
cloud_pod_radius = Slider(8, range=0..10)  # disabled
length = Slider(30, range=0..100)  # disabled
cloud_pod_thickness = Slider(10, range=1..10)  # disabled
python_3_script_5 = Python3Script(radius_out=cloud_pod_radius, length=length, thickness=cloud_pod_thickness)  # -> out, brep, radius_dim, thickness_dim; inputs radius_out: Double, length: Double, thickness: Double; disabled
# ---------- python_3_script_5: Python ----------
import Rhino.Geometry as rg
from math import pi

# Geometric Constraints
min_thickness = 1.2 # fabrication constraints
if thickness < min_thickness :
    print("------------")
    print(f"ERROR \n Thickness = {thickness}: The Cloud pod wall thickness is too small!")
    thickness = min_thickness
    print(f"Cloud pod wall thickness is adjusted to {min_thickness} mm")
    print("------------")

max_thickness = radius_out - 2 # 4mm diameter as a min hole 
if thickness > max_thickness :
    print("------------")
    print(f"ERROR \n Thickness: {thickness}mm - The Cloud pod hole is too small!")
    thickness = max_thickness
    print(f"Thickness is adjusted to {max_thickness}mm")
    print(f"The Cloud pod hole diameter is now {(radius_out - max_thickness)*2}mm")
    print("------------")

# inner cylinder 
plane = rg.Plane.WorldZX 
vect_ver = rg.Vector3d.ZAxis * radius_out
origin = rg.Point3d.Origin + vect_ver
plane_moved = rg.Plane(origin, plane.XAxis, plane.YAxis)

cir_inn = rg.Circle(plane_moved, radius_out - thickness)
cyl_inn = rg.Cylinder(cir_inn,length)

# outer cylinder 
cir_out = rg.Circle(plane_moved, radius_out)
cyl_out = rg.Cylinder(cir_out,length)

# cap holes 
brep_out = cyl_out.ToBrep(capBottom = True,capTop = True)
brep_inn = cyl_inn.ToBrep(capBottom = True,capTop = True)
#print(type(brep_out))
brep_list = rg.Brep.CreateBooleanDifference(brep_out,brep_inn,0.001)
#print(brep_list)
#print(type(brep_list[0]))

# final cloud pod
brep = brep_list[0]

# Preview Dimensions
radius_dim = rg.TextDot(text = "hole : " + str(round(radius_out-thickness,1)), location = origin) 

t = pi / 3
point_1 = cir_inn.Center
point_2 = cir_inn.PointAt(t)

trans_vec = rg.Vector3d(point_2 - point_1)
trans_vec.Unitize()
translation = rg.Transform.Translation(trans_vec * (radius_out - (thickness/2)))
thickness_point = cir_inn.Center
thickness_point.Transform(translation)

thickness_dim = rg.TextDot(text = "th : " + str(round(thickness,1)), location = thickness_point)
# ---------- end python_3_script_5 ----------
data_4 = Data(python_3_script_5.brep)  # disabled
data_5 = Data(python_3_script_5.radius_dim)  # disabled
data_6 = Data(python_3_script_5.thickness_dim)  # disabled
panel_5 = Panel(python_3_script_5.out)  # disabled

# ----
# 02. Parametric Hexagon / Cylinder
# input : thickness
cloud_pod_radius_2 = Slider(8, range=0..10)  # disabled
length_2 = Slider(30, range=0..120)  # disabled
# 04. Parametric Cloud Pods Along Curve
boolean_toggle = BooleanToggle(True)  # disabled
python_3_script_6 = Python3Script(radius_out=cloud_pod_radius_2, length=length_2, thickness=python_3_script_2.thickness, cylinder=boolean_toggle)  # -> out, brep, radius_dim, thickness_dim, a; inputs radius_out: Double, length: Double, thickness: Double, cylinder: Boolean; disabled
# ---------- python_3_script_6: Python ----------
import Rhino.Geometry as rg
import math


class Hexagon():

    def __init__(self, center, radius, plane):
        self.center = center
        self.radius = radius
        self.plane = plane

        self.vertices = self.create_verices()
        all_pts = self.vertices
        all_pts.append(all_pts[0])
        self.polyline = rg.Polyline(all_pts)
        self.curve = self.polyline.ToNurbsCurve()

    def create_verices(self):
        pts = []
        for i in range(6):
            #angle = i * math.pi / 3
            angle = i * math.pi / 3 + math.pi / 6  # +30° rotation to get the base right

            x = self.radius * math.cos(angle)
            y = self.radius * math.sin(angle)

            pts.append(self.plane.PointAt(x,y))
    
        return pts

# ----------------------
# Geometric Constraints
# ----------------------

min_thickness = 1.2 # fabrication constraints
if thickness < min_thickness :
    print("------------")
    print(f"ERROR \n Thickness = {thickness}: The Cloud pod wall thickness is too small!")
    thickness = min_thickness
    print(f"Cloud pod wall thickness is adjusted to {min_thickness} mm")
    print("------------")

max_thickness = radius_out - 2 # 4mm diameter as a mix hole 
if thickness > max_thickness :
    print("------------")
    print(f"ERROR \n Thickness: {thickness}mm - The Cloud pod hole is too small!")
    thickness = max_thickness
    print(f"Thickness is adjusted to {max_thickness}mm")
    print(f"The Cloud pod hole diameter is now {(radius_out - max_thickness)*2}mm")
    print("------------")

# Origin 
plane = rg.Plane.WorldZX 
vect_ver = rg.Vector3d.ZAxis * radius_out
origin = rg.Point3d.Origin + vect_ver
plane_moved = rg.Plane(origin, plane.XAxis, plane.YAxis)

# ----------------------
# Define Shape 
# ----------------------

if cylinder :
    # inner
    cir_inn = rg.Circle(plane_moved, radius_out - thickness)
    cyl_inn = rg.Cylinder(cir_inn,length)
    # outer
    cir_out = rg.Circle(plane_moved, radius_out)
    cyl_out = rg.Cylinder(cir_out,length)
    # breps with cap holes 
    brep_out = cyl_out.ToBrep(capBottom = True,capTop = True)
    brep_inn = cyl_inn.ToBrep(capBottom = True,capTop = True)
    #print(type(brep_out))
else : 
    hexagon_out = Hexagon(center = rg.Point3d.Origin, radius = radius_out, plane = plane_moved)
    hexagon_inn = Hexagon(center = rg.Point3d.Origin, radius = radius_out - thickness, plane = plane_moved)
    # inner hexagon
    cir_inn = hexagon_inn.curve
    cyl_inn = rg.Extrusion.Create(cir_inn, plane_moved, length, True)
    # outer hexagon
    cir_out = hexagon_out.curve
    cyl_out = rg.Extrusion.Create(cir_out, plane_moved, length, True)
    # breps 
    brep_out = cyl_out.ToBrep()
    brep_inn = cyl_inn.ToBrep()
    #print(type(brep_out))
 


brep_list = rg.Brep.CreateBooleanDifference(brep_out,brep_inn,0.001)
#print(brep_list)
#print(type(brep_list[0]))

# final cloud pod
brep = brep_list[0]

# ----------------------
# Preview Dimensions
# ----------------------

radius_dim = rg.TextDot(text = "hole : " + str(radius_out-thickness), location = origin) 

t = math.pi / 3
point_1 = origin
point_2 = cir_inn.PointAt(t)

trans_vec = rg.Vector3d(point_2 - point_1)
trans_vec.Unitize()
translation = rg.Transform.Translation(trans_vec * (radius_out - (thickness/2)))
thickness_point = origin
thickness_point.Transform(translation)

thickness_dim = rg.TextDot(text = "th : " + str(thickness), location = thickness_point)
# ---------- end python_3_script_6 ----------
data_7 = Data(python_3_script_6.brep)  # disabled
data_8 = Data(python_3_script_6.radius_dim)  # disabled
data_9 = Data(python_3_script_6.thickness_dim)  # disabled
data_10 = Data(python_3_script_6.a)  # disabled
panel_6 = Panel(python_3_script_6.out)  # disabled

panel_7 = Panel(data_3)
point_2 = Point(<point referenced from the Rhino model>)  # disabled
curve_3 = Curve(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)  # disabled

boolean_toggle_2 = BooleanToggle(True)  # disabled
# input : curve, thickness
cloud_pod_radius_3 = Slider(10, range=0..10)  # disabled
length_3 = Slider(119, range=0..120)  # disabled
python_3_script_7 = Python3Script(
    in_curve=curve_3,
    radius_out=cloud_pod_radius_3,
    length=length_3,
    thickness=python_3_script_2.thickness,
    cylinder=boolean_toggle_2)  # -> out, brep, radius_dim, thickness_dim, pods; inputs in_curve: Curve, radius_out: Double, length: Double, thickness: Double, cylinder: Boolean; disabled
# ---------- python_3_script_7: Python ----------
import Rhino.Geometry as rg
import math


class Hexagon():

    def __init__(self, center, radius, plane):
        self.center = center
        self.radius = radius
        self.plane = plane

        self.vertices = self.create_verices()
        all_pts = self.vertices
        all_pts.append(all_pts[0])
        self.polyline = rg.Polyline(all_pts)
        self.curve = self.polyline.ToNurbsCurve()

    def create_verices(self):
        pts = []
        for i in range(6):
            #angle = i * math.pi / 3
            angle = i * math.pi / 3 + math.pi / 6  # +30° rotation to get the base right

            x = self.radius * math.cos(angle)
            y = self.radius * math.sin(angle)

            pts.append(self.plane.PointAt(x,y))
    
        return pts

# ----------------------
# Geometric Constraints
# ----------------------

min_thickness = 1.2 # fabrication constraints
if thickness < min_thickness :
    print("------------")
    print(f"ERROR \n Thickness = {thickness}: The Cloud pod wall thickness is too small!")
    thickness = min_thickness
    print(f"Cloud pod wall thickness is adjusted to {min_thickness} mm")
    print("------------")

max_thickness = radius_out - 2 # 4mm diameter as a mix hole 
if thickness > max_thickness :
    print("------------")
    print(f"ERROR \n Thickness: {thickness}mm - The Cloud pod hole is too small!")
    thickness = max_thickness
    print(f"Thickness is adjusted to {max_thickness}mm")
    print(f"The Cloud pod hole diameter is now {(radius_out - max_thickness)*2}mm")
    print("------------")


# ----------------------
# Array of Pods
# ----------------------


# input curve 
t_params = in_curve.DivideByCount(8,False)
curve_pts = [in_curve.PointAt(t) for t in t_params]
#print(curve_pts)
pods = []
for p in curve_pts :

    # Origin 
    plane = rg.Plane.WorldZX 
    vect_ver = rg.Vector3d.ZAxis * radius_out
    origin = p + vect_ver #in relation to given point 
    plane_moved = rg.Plane(origin, plane.XAxis, plane.YAxis)

    # ----------------------
    # Define Shape 
    # ----------------------

    if cylinder :
        # inner
        cir_inn = rg.Circle(plane_moved, radius_out - thickness)
        cyl_inn = rg.Cylinder(cir_inn,length)
        # outer
        cir_out = rg.Circle(plane_moved, radius_out)
        cyl_out = rg.Cylinder(cir_out,length)
        # breps with cap holes 
        brep_out = cyl_out.ToBrep(capBottom = True,capTop = True)
        brep_inn = cyl_inn.ToBrep(capBottom = True,capTop = True)
        #print(type(brep_out))
    else : 
        hexagon_out = Hexagon(center = rg.Point3d.Origin, radius = radius_out, plane = plane_moved)
        hexagon_inn = Hexagon(center = rg.Point3d.Origin, radius = radius_out - thickness, plane = plane_moved)
        # inner hexagon
        cir_inn = hexagon_inn.curve
        cyl_inn = rg.Extrusion.Create(cir_inn, plane_moved, length, True)
        # outer hexagon
        cir_out = hexagon_out.curve
        cyl_out = rg.Extrusion.Create(cir_out, plane_moved, length, True)
        # breps 
        brep_out = cyl_out.ToBrep()
        brep_inn = cyl_inn.ToBrep()
        print(type(brep_out))
    


    brep_list = rg.Brep.CreateBooleanDifference(brep_out,brep_inn,0.001)
    #print(brep_list)
    #print(type(brep_list[0]))

    # final cloud pod
    brep = brep_list[0]
    pods.append(brep)

# ----------------------
# Preview Dimensions
# ----------------------

radius_dim = rg.TextDot(text = "hole : " + str(radius_out-thickness), location = origin) 

t = math.pi / 3
point_1 = origin
point_2 = cir_inn.PointAt(t)

trans_vec = rg.Vector3d(point_2 - point_1)
trans_vec.Unitize()
translation = rg.Transform.Translation(trans_vec * (radius_out - (thickness/2)))
thickness_point = origin
thickness_point.Transform(translation)

thickness_dim = rg.TextDot(text = "th : " + str(thickness), location = thickness_point)
# ---------- end python_3_script_7 ----------
data_11 = Data(python_3_script_7.brep)  # disabled
data_12 = Data(python_3_script_7.radius_dim)  # disabled
data_13 = Data(python_3_script_7.pods)  # disabled
data_14 = Data(python_3_script_7.thickness_dim)  # disabled

annotation_dot = AnnotationDot(Location=geo, PrimaryText=data_3)  # -> AnnotationDot, Location, PrimaryText, TextHeight

# ----
# output:
# cloud pods trimmed
data_15 = Data(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)

runner_weight_3 = Slider(136, range=50..150)  # disabled
impact_force_3 = Slider(1749, range=200..2000)  # disabled
shoe_size_3 = Slider(40, range=36..46)  # disabled

module_shape = BooleanToggle(True)
# input : point, thickness, length
range = Range(Domain=Domain(0, 1), Steps=expr("x+1", number_slider_5))
graph_mapper = GraphMapper(
    range,
    x0=0,
    x1=1,
    y0=0,
    y1=1,
    Ox=0.5079453588,
    Oy=0.1110839844,
    Px=0.8364002705,
    Py=0.1989315748,
    container_name="Parabola")

graph_mapper_2 = GraphMapper(
    range,
    x0=0,
    x1=1,
    y0=0,
    y1=1,
    A=-0.1932383903,
    B=0.6426160164,
    container_name="Linear",
    Graph_x0=0.2726579607,
    Graph_x1=0.7030376792,
    Graph_y0=0.589928031,
    Graph_y1=0.5067621469)
graph_mapper_3 = GraphMapper(range, x0=0, x1=1, y0=0, y1=1, container_name="Sine", Equation_px=[0, 0.4313787222], Equation_py=[0, 0.2989317775])
graph_mapper_4 = GraphMapper(
    range,
    x0=0,
    x1=1,
    y0=0,
    y1=1,
    Ox=0.1650178283,
    Oy=0.5478550792,
    Px=0.4384060502,
    Py=0.4252771735,
    container_name="Parabola")

# ----
# 07. Parametric Cloud Pods - Pressure maps
python_3_script_8 = Python3Script(
    in_point=origin,
    thickness=python_3_script_3.thickness,
    foot_length=python_3_script_3.foot_length,
    foot_width=python_3_script_3.foot_width,
    pod_density=number_slider_5,
    radius_out_min=python_3_script_3.radius_out_min,
    radius_out_max=python_3_script_3.radius_out_max,
    min_hole_diameter=python_3_script_3.min_hole_diameter,
    values=graph_mapper,
    radius_values=graph_mapper_4,
    cylinder=module_shape,
    double_array=double_array)  # -> out, curve_out, tangents, planes_out, graph_pts, brep, radius_dim, thickness_dim, length_dim, pods; inputs in_point: Point3d, thickness: Double, foot_length: Double, foot_width: Double, pod_density: Int32, radius_out_min: Double, radius_out_max: Double, min_hole_diameter: Double, values: list, radius_values: list, cylinder: Boolean
# ---------- python_3_script_8: Python ----------
import Rhino.Geometry as rg
import math


class Hexagon():

    def __init__(self, center, radius, plane):
        self.center = center
        self.radius = radius
        self.plane = plane

        self.vertices = self.create_verices()
        all_pts = self.vertices
        all_pts.append(all_pts[0])
        self.polyline = rg.Polyline(all_pts)
        self.curve = self.polyline.ToNurbsCurve()

    def create_verices(self):
        pts = []
        for i in range(6):
            angle = i * math.pi / 3
            #angle = i * math.pi / 3 + math.pi / 6  # +30° rotation to get the base right

            x = self.radius * math.cos(angle)
            y = self.radius * math.sin(angle)

            pts.append(self.plane.PointAt(x,y))
    
        return pts

# ----------------------
# Functions
# ----------------------

def remap(value, from_min, from_max, to_min, to_max):
    # Calculate the proportion of the value within the original range
    proportion = (value - from_min) / (from_max - from_min)
    # Map the value to the target range using the proportion
    remapped_value = to_min + (proportion * (to_max - to_min))
    #print(value)
    return remapped_value


width = 120 
# ----------------------
# Geometric Constraints
# ----------------------
"""
min_thickness = 1.2 # fabrication constraints
if thickness < min_thickness :
    print("------------")
    print(f"ERROR \n Thickness = {thickness}: The Cloud pod wall thickness is too small!")
    thickness = min_thickness
    print(f"Cloud pod wall thickness is adjusted to {min_thickness} mm")
    print("------------")

max_thickness = radius_out - 2 # 4mm diameter as a mix hole 
if thickness > max_thickness :
    print("------------")
    print(f"ERROR \n Thickness: {thickness}mm - The Cloud pod hole is too small!")
    thickness = max_thickness
    print(f"Thickness is adjusted to {max_thickness}mm")
    print(f"The Cloud pod hole diameter is now {(radius_out - max_thickness)*2}mm")
    print("------------")
"""

# ----------------------------------
# From show size to curve length 
# ----------------------------------

# create curve according to shoe size/ foot length
second_point_curve = in_point + (rg.Vector3d.XAxis * foot_length)
curve = rg.Polyline([in_point, second_point_curve]).ToNurbsCurve()

# divide curve - divide by length so pod spacing stays proportional
#pod_spacing = 15 #fixed number
pod_spacing = foot_length / pod_density # spaced proportionally
t_params = curve.DivideByLength(pod_spacing, True)
curve_pts = [curve.PointAt(t) for t in t_params]
print(f"curve points are in total: {len(curve_pts)}")

# normalize t_params to 0-1 range for mapping
t_min = t_params[0]
t_max = t_params[-1]

# curve manipulation
graph_pts = []
for i,p in enumerate(curve_pts):

    z_offset = remap(values[i], 0, 1, 0, 100)

    # move point in Z
    new_pt = rg.Point3d(p.X, p.Y, p.Z + z_offset)
    graph_pts.append(new_pt)

print(f"graph_pts are in total: {len(graph_pts)}")

# rebuild curve for visualization
curve_out = rg.Curve.CreateInterpolatedCurve(graph_pts, degree=3)

# -----------------------------------------------------
# Double Array of Pods with shift along curve tangents
# -----------------------------------------------------

if double_array:
    range_ = 2
else:
    range_ = 1

pods = []
for i in range(range_):
    
    if i == 0 :
        shift = 0 
    else:
        shift = pod_spacing/1.7 # shift the upper row related to pod_spacing
    
    pods_row = []
    tangents = []
    planes_out = []
    for j,p in enumerate(graph_pts) :

        if shift != 0 and j == len(graph_pts) - 1 :
            continue # remove last pod of the shifted array to fit the curve length
        else:
            # shift point along X for the second row
            shifted_p = p + rg.Vector3d.XAxis * shift
            shifted_p_2 = shifted_p + rg.Vector3d.ZAxis * shift

            # Origin 
            plane = rg.Plane.WorldZX 
            vect_ver = rg.Vector3d.ZAxis * 1 #radius_out
            origin = shifted_p_2 + vect_ver #in relation to given point 

            # evaluate curve tangent at this point
            curve_parameter = curve_out.ClosestPoint(shifted_p_2)[1] #finds the parameter of the point on a curve that is closest to testPoint
            tangent = curve_out.TangentAt(curve_parameter)
            tangent.Unitize()
            tangents.append(tangent)

            # plane from curve tangent - relates to manipulated curve
            plane_moved = rg.Plane(origin, -tangent, rg.Vector3d.CrossProduct(tangent, rg.Vector3d.YAxis))

            # plane from World XY
            #plane_moved = rg.Plane(origin, plane.XAxis, plane.YAxis)

            planes_out.append(plane_moved)

            # ---------------------------------------
            # Radius value for every point
            # ---------------------------------------

            # radius per pod ! define min and max from config file !
            radius_rem = remap(radius_values[j], 0.0, 1.0, radius_out_min, radius_out_max )
            #print(radius_rem)

            # ---------------------------------------
            # Fallback for impossible thickness !
            # ---------------------------------------

            min_radius_for_thickness = thickness + (min_hole_diameter / 2)

            if radius_rem < min_radius_for_thickness:
                print("------------")
                print(f"ERROR \n Radius: {radius_rem}mm - too small for thickness {thickness}mm, hole would be too tight!")
                radius_out = min_radius_for_thickness
                print(f"Radius is adjusted to {round(radius_out, 2)}mm")
                print(f"The Cloud pod hole diameter is now {min_hole_diameter}mm")
                print("------------")

            # ---------------------------------------
            # Define Shape 
            # ---------------------------------------

            if cylinder :
                # inner
                cir_inn = rg.Circle(plane_moved, radius_rem - thickness)
                cyl_inn = rg.Cylinder(cir_inn,foot_width)
                # outer
                cir_out = rg.Circle(plane_moved, radius_rem)
                cyl_out = rg.Cylinder(cir_out,foot_width)
                # breps with cap holes 
                brep_out = cyl_out.ToBrep(capBottom = True,capTop = True)
                brep_inn = cyl_inn.ToBrep(capBottom = True,capTop = True)
                #print(type(brep_out))
            else : 
                hexagon_out = Hexagon(center = rg.Point3d.Origin, radius = radius_rem, plane = plane_moved)
                hexagon_inn = Hexagon(center = rg.Point3d.Origin, radius = radius_rem - thickness, plane = plane_moved)
                # inner hexagon
                cir_inn = hexagon_inn.curve
                cyl_inn = rg.Extrusion.Create(cir_inn, plane_moved, width, True)
                # outer hexagon
                cir_out = hexagon_out.curve
                cyl_out = rg.Extrusion.Create(cir_out, plane_moved, width, True)
                # breps 
                brep_out = cyl_out.ToBrep()
                brep_inn = cyl_inn.ToBrep()
                #print(type(brep_out))
            
            brep_list = rg.Brep.CreateBooleanDifference(brep_out,brep_inn,0.001)
            #print(brep_list)
            #print(type(brep_list[0]))

            # final cloud pod
            brep = brep_list[0]
            pods_row.append(brep)

    pods.extend(pods_row)

# ----------------------
# Preview Dimensions
# ----------------------

#radius_dim = rg.TextDot(text = "hole : " + str(radius_out-thickness), location = origin) 

t = math.pi / 3
point_1 = origin
point_2 = cir_inn.PointAt(t)

trans_vec = rg.Vector3d(point_2 - point_1)
trans_vec.Unitize()
#translation = rg.Transform.Translation(trans_vec * (radius_out - (thickness/2)))
thickness_point = origin
#thickness_point.Transform(translation)

thickness_dim = rg.TextDot(text = "th : " + str(thickness), location = thickness_point)
length_dim = rg.TextDot(text = "foot length : " + str(round(foot_length,2)), location = in_point)
# ---------- end python_3_script_8 ----------
panel_8 = Panel(python_3_script_8.out)

data_16 = Data(python_3_script_8.planes_out)
data_17 = Data(python_3_script_8.graph_pts)
data_18 = Data(python_3_script_8.length_dim)
data_19 = Data(python_3_script_8.curve_out)

# ----
# output:
# cloud pods untrimmed
data_20 = Data(python_3_script_8.pods)

# ----
# input : thickness, size
data_21 = Data(python_3_script_3.scaled_outline)
# 08. Fit to total Brep
python_3_script_9 = Python3Script(scaled_outline=data_21, pods=data_20)  # -> out, a, b, c; inputs scaled_outline: Curve, pods: list of Brep
# ---------- python_3_script_9: Python ----------
import Rhino.Geometry as rg

# ----------------------
# Extrude Scaled Outline into a Solid Sole
# ----------------------

sole_height = -60  # mm, or pull from config if you want it data-driven

extrusion_vector = rg.Vector3d.ZAxis * sole_height
sole_extrusion = rg.Extrusion.Create(scaled_outline, sole_height, True)
sole_brep = sole_extrusion.ToBrep()
#a = sole_brep

brep_pods = rg.Brep.CreateBooleanUnion(pods,0.001)
print(type(brep_pods))
print(len(brep_pods))
print(type(sole_brep))

brep_list_1 = rg.Brep.CreateBooleanDifference(sole_brep, brep_pods[0], 0.001)
a = brep_list_1[0]
#print(brep_list_1)
#print(type(brep_list_1[0]))

#b = brep_pods[0]
brep_list_2 = rg.Brep.CreateBooleanIntersection(brep_pods[0], sole_brep, 0.0001)
print(len(brep_list_2))
b = brep_list_2[0]
# ---------- end python_3_script_9 ----------
data_22 = Data(python_3_script_9.a)
data_23 = Data(python_3_script_9.b)

# ----
# Visualization
unit_y = UnitY(Factor=-10)
amplitude = Amplitude(Vector=python_3_script_8.tangents, Amplitude=18)
move = Move(Geometry=data_19, Motion=unit_y)  # -> Geometry, Transform
vector_display = VectorDisplay(Anchor=python_3_script_8.graph_pts, Vector=amplitude)

# ----
# 06. Parametric Cloud Pods Along Curve
# input : point, thickness, length
number_slider_15 = Slider(14, range=0..14)  # disabled
cloud_pod_radius_4 = Slider(10, range=0..10)  # disabled
length_4 = Slider(119, range=0..120)  # disabled
range_2 = Range(Domain=Domain(0, 1), Steps=expr("x+1", number_slider_15))  # disabled
# PART 2  - 2.2 Computational Module Design
graph_mapper_5 = GraphMapper(
    range_2,
    x0=0,
    x1=1,
    y0=0,
    y1=1,
    Ox=0.4453163743,
    Oy=0.01035928726,
    Px=0.7350479364,
    Py=0.07274162769,
    container_name="Parabola")  # disabled
boolean_toggle_3 = BooleanToggle(True)  # disabled

python_3_script_10 = Python3Script(
    in_point=point,
    pod_density=number_slider_15,
    runner_weight=runner_weight_3,
    impact_force=impact_force_3,
    shoe_size=shoe_size_3,
    weight_min=number_slider,
    weight_max=number_slider_2,
    force_min=number_slider_3,
    force_max=number_slider_4)  # -> out, thickness, foot_length, rectangle, map_pts; inputs in_point: Point3d, runner_weight: Double, impact_force: Double, shoe_size: Double, weight_min: Double, weight_max: Double; disabled
# ---------- python_3_script_10: Python ----------
import Rhino.Geometry as rg

# ----------------------
# Fabrication Constraints (editable config)
# ----------------------
MIN_THICKNESS = 2.0    # foam injection limit, Vietnam supplier
MAX_THICKNESS = 4.5    # maximum wall thickness

# ----------------------
# Functions
# ----------------------
def remap(value, from_min, from_max, to_min, to_max):
    normalized = (value - from_min) / (from_max - from_min)
    return to_min + normalized * (to_max - to_min)

# EU shoe size to foot length in mm > curve length
def shoe_size_to_length(eu_size):
    return eu_size * 6.67 + 10  # rough formula


# ----------------------
# Score
# ----------------------
norm_weight = remap(runner_weight, weight_min, weight_max, 0.0, 1.0)
norm_force  = remap(impact_force, force_min, force_max, 0.0, 1.0)

score = 0.5 * norm_weight + 0.5 * norm_force

# ----------------------
# Profile Label & Thickness
# ----------------------
if score < 0.33:
    profile = "Soft"
    thickness = MIN_THICKNESS
elif score < 0.66:
    profile = "Medium"
    thickness = remap(0.5, 0.0, 1.0, MIN_THICKNESS, MAX_THICKNESS)
else:
    profile = "Firm"
    thickness = MAX_THICKNESS

# ----------------------
# Shoe Size to Foot Dimensions
# ----------------------
foot_length = remap(shoe_size, 36, 48, 225.0, 305.0)  # mm
foot_width  = remap(shoe_size, 36, 48, 85.0, 105.0)   # mm

corner_a = in_point
corner_b = in_point + (rg.Vector3d.XAxis * foot_length)
corner_c = in_point + (rg.Vector3d.XAxis * foot_length) + (rg.Vector3d.YAxis * foot_width)
corner_d = in_point + (rg.Vector3d.YAxis * foot_width)

rectangle = rg.Polyline([corner_a, corner_b, corner_c, corner_d, corner_a]).ToNurbsCurve()

pt_1 = corner_a + (rg.Vector3d.YAxis * foot_width / 2)
pt_2 = corner_b + (rg.Vector3d.YAxis * foot_width / 2)
middle_line = rg.Polyline([pt_1,pt_2]).ToNurbsCurve()

# divide curve - divide by length so pod spacing stays proportional
# similar to curve from foot length
pod_spacing = foot_length / (pod_density + 1) # spaced proportionally
t_params = middle_line.DivideByLength(pod_spacing, True)
map_pts = [middle_line.PointAt(t) for t in t_params]
print(f"curve points are in total: {len(map_pts)}")

print(f"Profile      : {profile}")
print(f"Load score   : {round(score, 3)}")
print(f"Thickness    : {round(thickness, 2)} mm")
print(f"EU size      : {shoe_size} mm")
print(f"Foot length  : {round(foot_length,2)} mm")
print(f"Foot width  : {round(foot_width,2)} mm")
# ---------- end python_3_script_10 ----------
cloud_pod_inputs_3 = Panel(python_3_script_10.out)  # disabled

graph_mapper_6 = GraphMapper(
    range_2,
    x0=0,
    x1=1,
    y0=0,
    y1=1,
    A=0,
    B=0,
    container_name="Linear",
    Graph_x0=0.1355134994,
    Graph_x1=0.8562877178,
    Graph_y0=0,
    Graph_y1=0)  # disabled

python_3_script_11 = Python3Script(
    in_point=point_2,
    pod_density=number_slider_15,
    radius_out=cloud_pod_radius_4,
    length=length_4,
    values=graph_mapper_6,
    thickness=python_3_script_2.thickness,
    foot_length=python_3_script_2.foot_length,
    cylinder=boolean_toggle_3)  # -> out, curve_out, graph_pts, brep, radius_dim, thickness_dim, pods; inputs in_point: Point3d, pod_density: Int32, radius_out: Double, length: Double, values: list, thickness: Double, foot_length: Double, cylinder: Boolean; disabled
# ---------- python_3_script_11: Python ----------
import Rhino.Geometry as rg
import math


class Hexagon():

    def __init__(self, center, radius, plane):
        self.center = center
        self.radius = radius
        self.plane = plane

        self.vertices = self.create_verices()
        all_pts = self.vertices
        all_pts.append(all_pts[0])
        self.polyline = rg.Polyline(all_pts)
        self.curve = self.polyline.ToNurbsCurve()

    def create_verices(self):
        pts = []
        for i in range(6):
            #angle = i * math.pi / 3
            angle = i * math.pi / 3 + math.pi / 6  # +30° rotation to get the base right

            x = self.radius * math.cos(angle)
            y = self.radius * math.sin(angle)

            pts.append(self.plane.PointAt(x,y))
    
        return pts

# ----------------------
# Functions
# ----------------------

def remap(value, from_min, from_max, to_min, to_max):
    # Calculate the proportion of the value within the original range
    proportion = (value - from_min) / (from_max - from_min)
    # Map the value to the target range using the proportion
    remapped_value = to_min + (proportion * (to_max - to_min))
    #print(value)
    return remapped_value

# ----------------------
# Geometric Constraints
# ----------------------

min_thickness = 1.2 # fabrication constraints
if thickness < min_thickness :
    print("------------")
    print(f"ERROR \n Thickness = {thickness}: The Cloud pod wall thickness is too small!")
    thickness = min_thickness
    print(f"Cloud pod wall thickness is adjusted to {min_thickness} mm")
    print("------------")

max_thickness = radius_out - 2 # 4mm diameter as a mix hole 
if thickness > max_thickness :
    print("------------")
    print(f"ERROR \n Thickness: {thickness}mm - The Cloud pod hole is too small!")
    thickness = max_thickness
    print(f"Thickness is adjusted to {max_thickness}mm")
    print(f"The Cloud pod hole diameter is now {(radius_out - max_thickness)*2}mm")
    print("------------")

# ----------------------
# From size to curve length 
# ----------------------
# Scale diameter range by shoe size
#foot_length = shoe_size_to_length(eu_size)
#scale_factor = foot_length / shoe_size_to_length(42)  # normalize to size 42
#d_max = base_d_max * scale_factor
#d_min = base_d_min * scale_factor

# create curve according to shoe size/ foot length
second_point_curve = in_point + (rg.Vector3d.XAxis * foot_length)
curve = rg.Polyline([in_point, second_point_curve]).ToNurbsCurve()

# divide curve - divide by length so pod spacing stays proportional
#pod_spacing = 15 #fixed number
pod_spacing = foot_length / pod_density # spaced proportionally
t_params = curve.DivideByLength(pod_spacing, True)
curve_pts = [curve.PointAt(t) for t in t_params]
print(f"curve points are in total: {len(curve_pts)}")

# normalize t_params to 0-1 range for mapping
t_min = t_params[0]
t_max = t_params[-1]

# curve manipulation
graph_pts = []
for i,p in enumerate(curve_pts):

    z_offset = remap(values[i], 0, 1, 0, 100)

    # move point in Z
    new_pt = rg.Point3d(p.X, p.Y, p.Z + z_offset)
    graph_pts.append(new_pt)

print(f"graph_pts are in total: {len(graph_pts)}")

# rebuild curve for visualization
curve_out = rg.Curve.CreateInterpolatedCurve(graph_pts, degree=3)

# ----------------------
# Double Array of Pods with shift
# ----------------------

pods = []
for i in range(1):
    
    if i == 0 :
        shift = 0 
    else:
        shift = pod_spacing/2 # shift the upper row related to pod_spacing
    
    pods_row = []
    for j,p in enumerate(graph_pts) :

        if shift != 0 and j == len(graph_pts) - 1 :
            continue # remove last pod of the shifted array to fit the curve length
        else:
            # shift point along X for the second row
            shifted_p = p + rg.Vector3d.XAxis * shift
            shifted_p_2 = shifted_p + rg.Vector3d.ZAxis * shift

            # Origin 
            plane = rg.Plane.WorldZX 
            vect_ver = rg.Vector3d.ZAxis * radius_out
            origin = shifted_p_2 + vect_ver #in relation to given point 
            plane_moved = rg.Plane(origin, plane.XAxis, plane.YAxis)

            # ----------------------
            # Define Shape 
            # ----------------------

            if cylinder :
                # inner
                cir_inn = rg.Circle(plane_moved, radius_out - thickness)
                cyl_inn = rg.Cylinder(cir_inn,length)
                # outer
                cir_out = rg.Circle(plane_moved, radius_out)
                cyl_out = rg.Cylinder(cir_out,length)
                # breps with cap holes 
                brep_out = cyl_out.ToBrep(capBottom = True,capTop = True)
                brep_inn = cyl_inn.ToBrep(capBottom = True,capTop = True)
                #print(type(brep_out))
            else : 
                hexagon_out = Hexagon(center = rg.Point3d.Origin, radius = radius_out, plane = plane_moved)
                hexagon_inn = Hexagon(center = rg.Point3d.Origin, radius = radius_out - thickness, plane = plane_moved)
                # inner hexagon
                cir_inn = hexagon_inn.curve
                cyl_inn = rg.Extrusion.Create(cir_inn, plane_moved, length, True)
                # outer hexagon
                cir_out = hexagon_out.curve
                cyl_out = rg.Extrusion.Create(cir_out, plane_moved, length, True)
                # breps 
                brep_out = cyl_out.ToBrep()
                brep_inn = cyl_inn.ToBrep()
                #print(type(brep_out))
            
            brep_list = rg.Brep.CreateBooleanDifference(brep_out,brep_inn,0.001)
            #print(brep_list)
            #print(type(brep_list[0]))

            # final cloud pod
            brep = brep_list[0]
            pods_row.append(brep)

    pods.extend(pods_row)

# ----------------------
# Preview Dimensions
# ----------------------

radius_dim = rg.TextDot(text = "hole : " + str(radius_out-thickness), location = origin) 

t = math.pi / 3
point_1 = origin
point_2 = cir_inn.PointAt(t)

trans_vec = rg.Vector3d(point_2 - point_1)
trans_vec.Unitize()
translation = rg.Transform.Translation(trans_vec * (radius_out - (thickness/2)))
thickness_point = origin
thickness_point.Transform(translation)

thickness_dim = rg.TextDot(text = "th : " + str(thickness), location = thickness_point)
# ---------- end python_3_script_11 ----------
data_24 = Data(python_3_script_11.brep)  # disabled
data_25 = Data(python_3_script_11.radius_dim)  # disabled
data_26 = Data(python_3_script_11.thickness_dim)  # disabled
data_27 = Data(python_3_script_11.pods)  # disabled

data_28 = Data(python_3_script_11.curve_out)  # disabled
data_29 = Data(python_3_script_11.graph_pts)  # disabled
